# Grasshopper definition ComponentSample.gh (Grasshopper 1.0.7)
# plug-ins: SplitCurves

series = Series(Start=0, Step=20, Count=10)
pt = Point(Point(-11.73134139, -6.817889966, 0))
crv = Curve(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)
X = UnitX(Factor=series)
yz = YZPlane(Origin=pt)
move = Move(Geometry=yz, Motion=X)  # -> Geometry, Transform
curve = SplitCurves(ClosedCurve=crv, Planes=move.Geometry)
item = ListItem(List=curve, Index=Slider(0, range=0..10), Wrap=True)
